# Grasshopper definition Simple_Element_test1.gh (Grasshopper 1.0.7)
# plug-ins: SolidFEM

surface = Surface(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)

# ---- group: Make Mesh from single Brep, without C#
brep = Brep([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])
deconstruct_brep = DeconstructBrep(Brep=brep)  # -> Faces, Edges, Vertices
mesh = Mesh(deconstruct_brep.Faces)
mesh_join = MeshJoin(Meshes=mesh)
weld_mesh = WeldMesh(Mesh=mesh_join, Angle=3.141592654)  # -> flatten(Result)

# ----
deconstruct_mesh = DeconstructMesh(Mesh=weld_mesh)  # -> flatten(Vertices), Faces, Colours, Normals

# ---- group: Make Mesh from single Brep, without C#
brep_2 = Brep(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)
deconstruct_brep_2 = DeconstructBrep(Brep=brep_2)  # -> Faces, Edges, Vertices
mesh_2 = Mesh(deconstruct_brep_2.Faces)
mesh_join_2 = MeshJoin(Meshes=mesh_2)
weld_mesh_2 = WeldMesh(Mesh=mesh_join_2, Angle=3.141592654)

# ----
list_item = ListItem(List=deconstruct_brep_2.Faces, Index="0", Wrap=True)
list_item_2 = ListItem(List=deconstruct_brep_2.Faces, Index="3", Wrap=True)
surface_closest_point = SurfaceClosestPoint(Point=deconstruct_mesh.Vertices, Surface=surface)  # -> Point, UVPoint, Distance
unit_z = UnitZ(Factor="-5")
smaller_than = SmallerThan(FirstNumber=surface_closest_point.Distance, SecondNumber="0.1")  # -> SmallerThan, OrEqualTo
equality = Equality(FirstNumber=surface_closest_point.Distance, SecondNumber="0.1")  # -> Equality, Inequality
dispatch = Dispatch(List=deconstruct_mesh.Vertices, DispatchPattern=smaller_than.SmallerThan)  # -> flatten(ListA), ListB
fem_load = FEMLoad(MeshList=weld_mesh_2, Type="2", Surface=list_item, Vector=unit_z)  # -> Load, Points, ResultantLoadAndArea
fem_boundaryonpoints = FEM_BoundaryOnPoints(Mesh=weld_mesh_2, SupportSurface=list_item_2, TypeOfSupport="2", Tx=True, Ty=True, Ty_2=True)
fem_material = FEMMaterial(YoungModulus=210000, PossionRatio=0.3, YieldingStress=355, MaterialWeight=7850)
unit_z_2 = UnitZ(Factor="-5")
surface_2 = Surface(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)
fem_load_2 = FEMLoad(MeshList=weld_mesh, Type="2", Surface=surface_2, Vector=unit_z_2)  # -> Load, Points, ResultantLoadAndArea
fem_boundaryonpoints_2 = FEM_BoundaryOnPoints(Mesh=weld_mesh, SupportPoints=dispatch.ListA, TypeOfSupport="1", Tx=True, Ty=True, Ty_2=True)
fem_material_2 = FEMMaterial(YoungModulus=210000, PossionRatio=0.3, YieldingStress=355, MaterialWeight=7850)
fe_solver = FESolver(Mesh=weld_mesh_2, ElementOrder=1, Loads=fem_load.Load, BoundaryConditions=fem_boundaryonpoints, Material=fem_material)  # -> U1, U2, U3, ElementStress, NodeStress, Diagonstics, FE_Mesh
panel = Panel(weld_mesh_2)
fe_solver_2 = FESolver(
    Mesh=weld_mesh,
    ElementOrder=1,
    Loads=fem_load_2.Load,
    BoundaryConditions=fem_boundaryonpoints_2,
    Material=fem_material_2)  # -> U1, U2, U3, ElementStress, NodeStress, Diagonstics, FE_Mesh
panel_2 = Panel(weld_mesh)
meshpreview = MeshPreview(AnalysedFEMesh=fe_solver.FE_Mesh, Type=Slider(2, range=0..10), DisplacementScaling=1)  # -> DeformedModel, DeformedMesh
meshpreview_2 = MeshPreview(AnalysedFEMesh=fe_solver_2.FE_Mesh, Type=Slider(1, range=0..10), DisplacementScaling=Slider(503, range=0..1000))  # -> DeformedModel, DeformedMesh
mesh_3 = Mesh(meshpreview.DeformedMesh)
mesh_4 = Mesh(meshpreview_2.DeformedMesh)
mesh_edges = MeshEdges(Mesh=mesh_4)  # -> NakedEdges, InteriorEdges, NonManifoldEdges
